# Grasshopper definition IG_Mesh__Test-Hui.gh (Grasshopper 1.0.7)
# plug-ins: IG-Mesh, ShapeDiverForGrasshopper

sddp = ShapeDiverDocumentPayload({AbsoluteTolerance=0, AngleTolerance=0, DistanceDisplayPrecision=0, GltfVersion="Gltf2", GrasshopperVersion="1.0.0007", InputGroups="{}", OutputGroups="{}", RelativeTolerance=0, RhinoVersion="7.29.23107.3001", UnitSystem=0, VersionCreated="1.15.0.0", VersionSaved="1.15.0.0"})
panel = Panel("C:\Users\WANGH0M\Desktop\geometrylab7\obj_triangle\hydrographics_sim_clear.obj")
load_trimesh = LoadTriMesh(FileLocation=panel)
barycenter = Barycenter(Mesh=load_trimesh)
corner_normal = CornerNormal(DegreeThreshold=10)
face_normal = FaceNormal(Mesh=load_trimesh)
gaussian_curvature = GaussianCurvature(Mesh=load_trimesh)
mesh_info = MeshInfo(Mesh=load_trimesh)  # -> Vertex, Face, Centroid, Volume
boundary_edge = BoundaryEdge(Mesh=load_trimesh)  # -> BoundaryEdges, VertexIndicesOfTheBoundaryEdges, BoundaryTriangleIndices
boundary_loop_points = BoundaryLoopPoints(Mesh=load_trimesh)  # -> BoundaryIndex, BoundaryVertex
signed_distance = SignedDistance(Signed_type=4)  # -> SignedDistance, ClosestFaceIndex, ClosestPoint
addition = Addition(A=barycenter, B=face_normal)
bounds = Bounds(Numbers=gaussian_curvature)
line = Line(StartPoint=barycenter, EndPoint=addition)
deconstruct_domain = DeconstructDomain(Domain=bounds)  # -> Start, End
gradient = Gradient(
    LowerLimit=deconstruct_domain.Start,
    UpperLimit=deconstruct_domain.End,
    Parameter=gaussian_curvature,
    stops=[0: RGB(234, 38, 0), 0.25: RGB(234, 126, 0), 0.5: RGB(254, 244, 84), 0.75: RGB(173, 203, 249), 1: RGB(75, 107, 169)])
winding_number = WindingNumber(Mesh=load_trimesh, QueryPoints=gradient)
custom_preview = CustomPreview(Geometry=load_trimesh, Material=gradient)
